# Dynamo graph ASC - HS2 IFC Relocation for Revit.dyn "Move IFC from WCS and Rotate Ver2" (Dynamo 2.0.2.6826)

select_model_s_to_move = DSModelElementsSelection()  # 1 picked in the model; graph input
code_block = CodeBlock { "Site - Project Base Point"; }
byName = Category.ByName(name=code_block)
all_elements_of_category = ElementsOfCategory(Category=byName)
code_block_2 = CodeBlock { "Angle to True North"; }
getParameterValueByName = Element.GetParameterValueByName(element=all_elements_of_category, parameterName=code_block_2)
element_setrotation = Custom[Element SetRotation](element=select_model_s_to_move, degree=getParameterValueByName)  # Set the angle of the element around its local Z-axis. (Same as the Rotate command in Revit)
code_block_3 = CodeBlock { "E/W"; }
getParameterValueByName_2 = Element.GetParameterValueByName(element=all_elements_of_category, parameterName=code_block_3)
code_block_4 = CodeBlock { "N/S"; }
getParameterValueByName_3 = Element.GetParameterValueByName(element=all_elements_of_category, parameterName=code_block_4)
byCoordinates = Point.ByCoordinates(x=getParameterValueByName_2, y=getParameterValueByName_3)
byCoordinates_2 = Point.ByCoordinates()
ZAxis = Vector.ZAxis()
rotate = Geometry.Rotate(geometry=byCoordinates, origin=byCoordinates_2, axis=ZAxis, degrees=getParameterValueByName)
X = Point.X(point=rotate)
code_block_5 = CodeBlock(x=X) { -x; }
Y = Point.Y(point=rotate)
code_block_6 = CodeBlock(x=Y) { -x; }
byCoordinates_3 = Vector.ByCoordinates(x=code_block_5, y=code_block_6)
moveByVector = Element.MoveByVector(element=element_setrotation, vector=byCoordinates_3)
