# Dynamo graph Copy from Arch.dyn (Dynamo 2.12.1.8246)
# packages: archi-lab.net 2023.213.1722, Rhythm 2023.2.2, bimorphNodes 4.2.4

getDocuments = archilab.Revit.Selection.Select.GetDocuments()
links = Links("JCRSE-BIG-ARC-M3D-00001.rvt : 4 : location JRCSE, Sevilla")
categories = Categories("OST_StructuralColumns")
ofCategory = Revit.LinkElement.OfCategory(linkInstance=links, category=categories)
ʳʰʸᵗʰᵐ_documents = Rhythm.Revit.Application.Documents.CopyElementsFromLinkedDocument(sourceDocument=getDocuments.Link_Doc, sourceInstance=getDocuments.Link_Instance, elements=ofCategory)
watch = Watch(ʳʰʸᵗʰᵐ_documents)
watch_2 = Watch(getDocuments.Link_Name)
