# Dynamo graph Create sheets from Excel.dyn (Dynamo 2.16.2.5624)
# packages: Rhythm 2023.2.2

file_path = Filename(".\Sheets.xlsx")
file_from_path = FileObject(path=file_path)
code_block = CodeBlock { "Sheet1"; }
importExcel = Data.ImportExcel(file=file_from_path, sheetName=code_block)
watch = Watch(importExcel)
transpose = List.Transpose(lists=watch)
watch_2 = Watch(transpose)

# group: Name
code_block_2 = CodeBlock { 1; }
getItemAtIndex = List.GetItemAtIndex(list=watch_2, index=code_block_2)
restOfItems = List.RestOfItems(list=getItemAtIndex)

# group: Number
code_block_3 = CodeBlock { 0; }
getItemAtIndex_2 = List.GetItemAtIndex(list=watch_2, index=code_block_3)
restOfItems_2 = List.RestOfItems(list=getItemAtIndex_2)

titleblock_types = TitleblockTypes("BHE_TitleBlocks_A0-A1-A2:BHE_A1")
byNameNumberTitleBlock = Sheet.ByNameNumberTitleBlock(sheetName=restOfItems, sheetNumber=restOfItems_2, titleBlockFamilyType=titleblock_types)
code_block_4 = CodeBlock { "BHE_Sheet Purpose"; }
code_block_5 = CodeBlock { "3. Drawings"; }
setParameterByName = Element.SetParameterByName(element=byNameNumberTitleBlock, parameterName=code_block_4, value=code_block_5)
code_block_6 = CodeBlock { "Drawn By"; }
code_block_7 = CodeBlock { "LM"; }
setParameterByName_2 = Element.SetParameterByName(element=setParameterByName, parameterName=code_block_6, value=code_block_7)
