# Dynamo graph Create worksets (Player).dyn (Dynamo 2.16.2.5624)
# packages: archi-lab.net 2023.213.1722

string = StringInput("BH_ELEM_AREA_Test 1")  # graph input
string_2 = StringInput("BH_ELEM_AREA_Test 2")  # graph input
list_create = List.Create(item0=string, item1=string_2)
byName = archilab.Revit.Elements.Workset.ByName(name=list_create)
