# Dynamo graph Create worksets from Excel.dyn (Dynamo 2.16.2.5624)
# packages: archi-lab.net 2023.213.1722

file_path = Filename(".\Worksets.xlsx")  # graph input
code_block = CodeBlock { "Sheet 1"; }
openXMLImportExcel = Data.OpenXMLImportExcel(filePath=file_path, sheetName=code_block)
byName = archilab.Revit.Elements.Workset.ByName(name=openXMLImportExcel)
