# Dynamo graph Duplicate Views.dyn (Dynamo 2.12.1.8246)
# packages: Rhythm 2023.2.2, Clockwork for Dynamo 1.x 1.34.0, archi-lab.net 2023.213.1722

views = Views("P080101.G00")
views_2 = Views("P080101.L01")
views_3 = Views("P080101.L02")
views_4 = Views("P080101.L03")
views_5 = Views("P080101.L04")
views_6 = Views("P080101.M00")
views_7 = Views("P080101.M03")
views_8 = Views("P080101.R00")
views_9 = Views("P080101.R01")
list_create = List.Create(item0=views, item1=views_2, item2=views_3, item3=views_4, item4=views_5, item5=views_6, item6=views_7, item7=views_8, item8=views_9)
list_create_2 = List.Create(item0=views)
string_from_object = FromObject(object=list_create_2)
code_block = CodeBlock { 25; }
code_block_2 = CodeBlock { -26; }
remove = String.Remove(string=string_from_object, startIndex=code_block, count=code_block_2)
code_block_3 = CodeBlock { 11; }
code_block_4 = CodeBlock { " - CO"; }
insert = String.Insert(string=remove, index=code_block_3, toInsert=code_block_4)
code_block_5 = CodeBlock { 17; }
code_block_6 = CodeBlock { -2; }
remove_2 = String.Remove(string=insert, startIndex=code_block_5, count=code_block_6)
list_create_3 = List.Create(item0=views_2)
string_from_object_2 = FromObject(object=list_create_3)
code_block_7 = CodeBlock { 25; }
code_block_8 = CodeBlock { -26; }
remove_3 = String.Remove(string=string_from_object_2, startIndex=code_block_7, count=code_block_8)
code_block_9 = CodeBlock { 11; }
code_block_10 = CodeBlock { " - CO"; }
insert_2 = String.Insert(string=remove_3, index=code_block_9, toInsert=code_block_10)
code_block_11 = CodeBlock { 17; }
code_block_12 = CodeBlock { -2; }
remove_4 = String.Remove(string=insert_2, startIndex=code_block_11, count=code_block_12)
list_create_4 = List.Create(item0=views_3)
string_from_object_3 = FromObject(object=list_create_4)
code_block_13 = CodeBlock { 25; }
code_block_14 = CodeBlock { -26; }
remove_5 = String.Remove(string=string_from_object_3, startIndex=code_block_13, count=code_block_14)
code_block_15 = CodeBlock { 11; }
code_block_16 = CodeBlock { " - CO"; }
insert_3 = String.Insert(string=remove_5, index=code_block_15, toInsert=code_block_16)
code_block_17 = CodeBlock { 17; }
code_block_18 = CodeBlock { -2; }
remove_6 = String.Remove(string=insert_3, startIndex=code_block_17, count=code_block_18)
list_create_5 = List.Create(item0=views_4)
string_from_object_4 = FromObject(object=list_create_5)
code_block_19 = CodeBlock { 25; }
code_block_20 = CodeBlock { -26; }
remove_7 = String.Remove(string=string_from_object_4, startIndex=code_block_19, count=code_block_20)
code_block_21 = CodeBlock { 11; }
code_block_22 = CodeBlock { " - CO"; }
insert_4 = String.Insert(string=remove_7, index=code_block_21, toInsert=code_block_22)
code_block_23 = CodeBlock { 17; }
code_block_24 = CodeBlock { -2; }
remove_8 = String.Remove(string=insert_4, startIndex=code_block_23, count=code_block_24)
list_create_6 = List.Create(item0=views_5)
string_from_object_5 = FromObject(object=list_create_6)
code_block_25 = CodeBlock { 25; }
code_block_26 = CodeBlock { -26; }
remove_9 = String.Remove(string=string_from_object_5, startIndex=code_block_25, count=code_block_26)
code_block_27 = CodeBlock { 11; }
code_block_28 = CodeBlock { " - CO"; }
insert_5 = String.Insert(string=remove_9, index=code_block_27, toInsert=code_block_28)
code_block_29 = CodeBlock { 17; }
code_block_30 = CodeBlock { -2; }
remove_10 = String.Remove(string=insert_5, startIndex=code_block_29, count=code_block_30)
list_create_7 = List.Create(item0=views_6)
string_from_object_6 = FromObject(object=list_create_7)
code_block_31 = CodeBlock { 25; }
code_block_32 = CodeBlock { -26; }
remove_11 = String.Remove(string=string_from_object_6, startIndex=code_block_31, count=code_block_32)
code_block_33 = CodeBlock { 11; }
code_block_34 = CodeBlock { " - CO"; }
insert_6 = String.Insert(string=remove_11, index=code_block_33, toInsert=code_block_34)
code_block_35 = CodeBlock { 17; }
code_block_36 = CodeBlock { -2; }
remove_12 = String.Remove(string=insert_6, startIndex=code_block_35, count=code_block_36)
list_create_8 = List.Create(item0=views_7)
string_from_object_7 = FromObject(object=list_create_8)
code_block_37 = CodeBlock { 25; }
code_block_38 = CodeBlock { -26; }
remove_13 = String.Remove(string=string_from_object_7, startIndex=code_block_37, count=code_block_38)
code_block_39 = CodeBlock { 11; }
code_block_40 = CodeBlock { " - CO"; }
insert_7 = String.Insert(string=remove_13, index=code_block_39, toInsert=code_block_40)
code_block_41 = CodeBlock { 17; }
code_block_42 = CodeBlock { -2; }
remove_14 = String.Remove(string=insert_7, startIndex=code_block_41, count=code_block_42)
list_create_9 = List.Create(item0=views_8)
string_from_object_8 = FromObject(object=list_create_9)
code_block_43 = CodeBlock { 25; }
code_block_44 = CodeBlock { -26; }
remove_15 = String.Remove(string=string_from_object_8, startIndex=code_block_43, count=code_block_44)
code_block_45 = CodeBlock { 11; }
code_block_46 = CodeBlock { " - CO"; }
insert_8 = String.Insert(string=remove_15, index=code_block_45, toInsert=code_block_46)
code_block_47 = CodeBlock { 17; }
code_block_48 = CodeBlock { -2; }
remove_16 = String.Remove(string=insert_8, startIndex=code_block_47, count=code_block_48)
list_create_10 = List.Create(item0=views_9)
string_from_object_9 = FromObject(object=list_create_10)
code_block_49 = CodeBlock { 25; }
code_block_50 = CodeBlock { -26; }
remove_17 = String.Remove(string=string_from_object_9, startIndex=code_block_49, count=code_block_50)
code_block_51 = CodeBlock { 11; }
code_block_52 = CodeBlock { " - CO"; }
insert_9 = String.Insert(string=remove_17, index=code_block_51, toInsert=code_block_52)
code_block_53 = CodeBlock { 17; }
code_block_54 = CodeBlock { -2; }
remove_18 = String.Remove(string=insert_9, startIndex=code_block_53, count=code_block_54)
list_create_11 = List.Create(item0=remove_2, item1=remove_4, item2=remove_6, item3=remove_8, item4=remove_10, item5=remove_12, item6=remove_14, item7=remove_16, item8=remove_18)
duplicate = Custom[View.Duplicate](view=list_create, name=list_create_11)  # package Clockwork for Dynamo 1.x; Duplicates a given view
view_templates = ViewTemplatesUi("Structural Plan - Coordination")
setViewTemplate = archilab.Revit.Views.Views.SetViewTemplate(view=duplicate, viewTemplate=view_templates)
watch = Watch(list_create_11)
