# Dynamo graph Export Worksets to excel.dyn (Dynamo 2.12.1.8246)
# packages: archi-lab.net 2023.213.1722

worksets = WorksetUi()  # nothing selected
file_path = Filename("C:\Users\lmeisinger\OneDrive - Buro Happold\Projects\Project W\Worksets.xlsx")
code_block = CodeBlock { "Sheet 1"; }
code_block_2 = CodeBlock { 0; }
code_block_3 = CodeBlock { 0; }
getAll = archilab.Revit.Elements.Workset.GetAll()
name = archilab.Revit.Elements.Workset.Name(workset=getAll)
exportToExcel = Data.ExportToExcel(filePath=file_path, sheetName=code_block, startRow=code_block_2, startColumn=code_block_3, data=name)
