# Dynamo graph Input Mark_last 3 digits.dyn (Dynamo 2.0.2.6826)

select_model_elements = DSModelElementsSelection()  # 200 picked in the model
code_block = CodeBlock { "Mark"; }
code_block_2 = CodeBlock { "Mark"; }
code_block_3 = CodeBlock { "AssetName_3"; }
getParameterValueByName = Element.GetParameterValueByName(element=select_model_elements, parameterName=code_block_3)
setParameterByName = Element.SetParameterByName(element=select_model_elements, parameterName=code_block_2, value=getParameterValueByName)
code_block_4 = CodeBlock { "Mark"; }
getParameterValueByName_2 = Element.GetParameterValueByName(element=setParameterByName, parameterName=code_block_4)
string = StringInput("Footpath SCL/13 Green Overbridge Pile")
string_2 = StringInput("")
replace = String.Replace(str=getParameterValueByName_2, searchFor=string, replaceWith=string_2)
string_3 = StringInput("Footpath SCL/13 Green Overbridge Secant Pile ")
replace_2 = String.Replace(str=replace, searchFor=string_3, replaceWith=string_2)
setParameterByName_2 = Element.SetParameterByName(element=select_model_elements, parameterName=code_block, value=replace_2)
