# Dynamo graph Link All Revit files.dyn (Dynamo 2.12.1.8246)
# packages: Morpheus 2019.8.26

sharedCoordinates = Custom[LinkModel.SharedCoordinates]()  # package Morpheus; Link models with shared coordinates. Optionally, the node can place the models on the selected worksets and pin them in place.; unwired: Filepaths
directory_path = Directory("C:\Users\lmeisinger\OneDrive - Buro Happold\Projects\Project W\Architect\Models\230210")
directory_from_path = DirectoryObject(path=directory_path)
code_block = CodeBlock { "*.rvt"; }
getDirectoryContents = FileSystem.GetDirectoryContents(directory=directory_from_path, searchString=code_block)
file_path = Filename("..\..\Projects\Project W\Architect\Models\230215\PW-2022002D-P0803-WAT-PL-ARC-DDE-000-XA-000003.rvt")
file_path_2 = Filename("..\..\Projects\Project W\Architect\Models\230215\PW-2022002D-P0803-WAT-PL-ARC-DDE-000-XA-000007.rvt")
list_create = List.Create(item0=file_path, item1=file_path_2)
sharedCoordinates_2 = Custom[LinkModel.SharedCoordinates](Filepaths=list_create)
