# Dynamo graph ModelClean.dyn "StructuralModelCleanOut2018+" (Dynamo 2.12.1.8246)
# packages: archi-lab.net 2023.213.1722

# group: INFO CARD
# note: DESCRIPTION
# For structural template 2018onwards.
# This deletes all view, sheets, schedules and all linked files in preparation for a clean model issue.
# Starting Screen and its relevant views and schedules are not removed.
# INSTRUCTION (Follow blue tips in the script):
# 1. DETACH YOUR MODEL PRIOR TO RUNNING
# 2. Check view names in first panel below you will only need to change these if you have altered from the standard template.
# FUTURE UPDATES
# Looking to see if its possible to auto purge all unused families etc.
# AUTHORS:
# kevin.munro@burohappold.com
# LAST UPDATE:   22.11.2019
# UNITS:           (units independent)
# DEPENDENCIES:  None
# REVIT VER.:        (version 2018 onwards)
# DYNAMO VER.:   1.3.4

# group: Default Names For Revit 2018-2019 Structural Template
schedule_title = CodeBlock { "Levels - Documentation Start Page"; }
starting_screen_title = CodeBlock { "Starting Screen"; }
n3d_view_tile = CodeBlock { "Cover Sheet Drawings"; }  # "3D View Tile"

# group: Schedules - Except "Levels - Documentation Start Page"
view_type = ViewTypesUi("Schedule")
getByType = archilab.Revit.Views.Views.GetByType(viewType=view_type)
name = Element.Name(element=getByType)
contains = String.Contains(string=name, searchFor=schedule_title)
filterByBoolMask = List.FilterByBoolMask(list=getByType, mask=contains)
watch = Watch(filterByBoolMask.in)

# group: Sheets - Except "Starting Screen"
categories = Categories("OST_Sheets")  # graph input
all_elements_of_category = ElementsOfCategory(Category=categories)
name_2 = Element.Name(element=all_elements_of_category)
contains_2 = String.Contains(string=name_2, searchFor=starting_screen_title)
filterByBoolMask_2 = List.FilterByBoolMask(list=all_elements_of_category, mask=contains_2)
watch_2 = Watch(filterByBoolMask_2.in)

# group: Views - Except "Cover Sheet Drawings"
categories_2 = Categories("OST_Views")  # graph input
all_elements_of_category_2 = ElementsOfCategory(Category=categories_2)

isNull = Object.IsNull(object=all_elements_of_category_2)
filterByBoolMask_3 = List.FilterByBoolMask(list=all_elements_of_category_2, mask=isNull)

# group (continued): Views - Except "Cover Sheet Drawings"
name_3 = Element.Name(element=filterByBoolMask_3.out)
contains_3 = String.Contains(string=name_3, searchFor=n3d_view_tile)
filterByBoolMask_4 = List.FilterByBoolMask(list=filterByBoolMask_3.out, mask=contains_3)

# group: Linked Files
element_types = ElementTypes("RevitLinkInstance")  # graph input
all_elements_of_type = ElementsOfType(element_type=element_types)
element_types_2 = ElementTypes("RevitLinkType")  # graph input
all_elements_of_type_2 = ElementsOfType(element_type=element_types_2)
element_types_3 = ElementTypes("CADLinkType")  # graph input
all_elements_of_type_3 = ElementsOfType(element_type=element_types_3)
create = List.Create(item0=all_elements_of_type, item1=all_elements_of_type_2, item2=all_elements_of_type_3)
flatten = List.Flatten(list=create)

# group: Combines Into One LIst
create_2 = List.Create(item0=filterByBoolMask.out, item1=filterByBoolMask_2.out, item2=filterByBoolMask_4.out, item3=flatten)
flatten_2 = List.Flatten(list=create_2)

# group: Deletes Elements
boolean = BoolSelector(true)  # graph input
python_script = Python(IN[0]=flatten_2, IN[1]=boolean)  # IronPython2
# ---------- python_script.python (28 lines) ----------
import clr

clr.AddReference("RevitServices")
import RevitServices
from RevitServices.Persistence import DocumentManager
from RevitServices.Transactions import TransactionManager
doc = DocumentManager.Instance.CurrentDBDocument

def tolist(obj1):
	if hasattr(obj1,"__iter__"): return obj1
	else: return [obj1]

ids = [e.Id for e in UnwrapElement(tolist(IN[0]) )]

if IN[1]:
	deleted, failed = [], []
	TransactionManager.Instance.EnsureInTransaction(doc)
	for id in ids:
		try:
			del_id = doc.Delete(id)
			deleted.extend([d.ToString() for d in del_id])
		except : failed.append(id.ToString() )
	TransactionManager.Instance.TransactionTaskDone()
	s = set(deleted)
	failed1 = [x for x in failed if x not in s]
	OUT = len(deleted), ';'.join(deleted), ';'.join(failed1)
else:
	OUT = "Set confirm to True", "", ""
# ----------------------------------------
