# Dynamo graph Place Beams.dyn (Dynamo 2.12.1.8246)
# packages: archi-lab.net 2023.213.1722

select_model_elements = DSModelElementsSelection()  # 97 picked in the model
curve = CurveElement.Curve(curveElement=select_model_elements)
family_types = FamilyTypes("BHE_StructuralFraming_Fabricated_I_Section:FB1000x800x604")
levels = Levels("Level Retail 06 SSL")
beamByCurve = Custom[StructuralFraming.BeamByCurve](curve=curve, structuralFramingType=family_types, level=levels)  # package archi-lab.net; This node will take an input of curves and attempt to make a structural framing member by type and level.
