# Dynamo graph Push Paramters to Excel.dyn (Dynamo 2.16.2.5624)

categories = Categories("OST_StructuralColumns")
categories_2 = Categories("OST_StructuralFraming")
list_create = List.Create(item0=categories, item1=categories_2)
all_elements_of_category = ElementsOfCategory(Category=list_create)
list_create_2 = List.Create(item0=all_elements_of_category)
string_from_object = FromObject(object=list_create_2)
code_block = CodeBlock { "RC"; true; }
contains = String.Contains(string=string_from_object, searchFor=code_block.out0, ignoreCase=code_block.out1)
filterByBoolMask = List.FilterByBoolMask(list=list_create_2, mask=contains)
watch = Watch(filterByBoolMask.out)
getLocation = Element.GetLocation(element=watch)
file_path = Filename("C:\Users\lmeisinger\OneDrive - Buro Happold\Projects\Rathbone Place\Steel Members.xlsx")
code_block_2 = CodeBlock { "Steel Members"; }
code_block_3 = CodeBlock { 0; 1; }
boolean = BoolSelector(true)
exportToExcel = Data.ExportToExcel(filePath=file_path, sheetName=code_block_2, startRow=code_block_3.out1, startColumn=code_block_3.out0, overWrite=boolean, writeAsString=boolean)  # unwired: data
value = Parameter.Value()  # unwired: parameter
