# Dynamo graph Straighten Columns.dyn (Dynamo 2.12.1.8246)
# packages: Clockwork for Dynamo 2.x 2.6.0

select_model_elements = DSModelElementsSelection()  # 504 picked in the model
location = Custom[Element.Location+](element=select_model_elements)  # package Clockwork for Dynamo 2.x; Returns the location of an element as point, curve or curve loop, along with some booleans to help filtering the results. Unlike the OOTB Element.GetLocation node, it also returns sketch lines of sketch-based elements like floor slabs as well as the element's rotation property. Additionally, it supports quite a few more element types (e.g. railings, stairs etc.).
watch = Watch(location.curves)

# group: Start Point
startPoint = Curve.StartPoint(curve=watch)
X = Point.X(point=startPoint)
Y = Point.Y(point=startPoint)

# group: End Point
endPoint = Curve.EndPoint(curve=watch)
X_2 = Point.X(point=endPoint)
Y_2 = Point.Y(point=endPoint)

# group: X Translation
sub = X - X_2

# group: Y Translation
sub_2 = Y - Y_2

# group: New End Points
translate = Geometry.Translate(geometry=endPoint, xTranslation=sub, yTranslation=sub_2)

byStartPointEndPoint = Line.ByStartPointEndPoint(startPoint=startPoint, endPoint=translate)
setLocation = Element.SetLocation(element=select_model_elements, geometry=byStartPointEndPoint)
