# Dynamo graph Toogle.Workset.Visibility.dyn (Dynamo 2.12.1.8246)
# packages: archi-lab.net 2023.213.1722

views = Views("{3D - Liam.MeisingerRX942}")
worksets = WorksetUi("BHE_LINK_REVIT_ARCH")
workset_visibility = WorksetVisibilityUi("Hidden")
setWorksetVisibility = archilab.Revit.Views.Views.SetWorksetVisibility(view=views, worksets=worksets, visibility=workset_visibility)
