# Dynamo graph Update Aconex Numbers.dyn (Dynamo 2.12.1.8246)
# packages: archi-lab.net 2023.213.1722

categories = Categories("OST_Sheets")
byCategory = archilab.Revit.Selection.Select.ByCategory(category=categories)
code_block = CodeBlock { 0; }
removeItemAtIndex = List.RemoveItemAtIndex(list=byCategory, indices=code_block)
code_block_2 = CodeBlock { "SHT_Aconex Number"; }

# group: Getting Aconex Numbers vs Design Team Numbers
file_path = Filename("C:\Users\lmeisinger\OneDrive - Buro Happold\Projects\Project W\Aconex numbers.xlsx")
file_from_path = FileObject(path=file_path)
code_block_3 = CodeBlock { "Sheet1"; }
boolean = BoolSelector(true)
boolean_2 = BoolSelector(false)
importExcel = Data.ImportExcel(file=file_from_path, sheetName=code_block_3, readAsStrings=boolean, showExcel=boolean_2)
transpose = List.Transpose(lists=importExcel)
code_block_4 = CodeBlock { 1; }
getItemAtIndex = List.GetItemAtIndex(list=transpose, index=code_block_4)
code_block_5 = CodeBlock { 0; }
removeItemAtIndex_2 = List.RemoveItemAtIndex(list=getItemAtIndex, indices=code_block_5)
watch = Watch(removeItemAtIndex_2)
code_block_6 = CodeBlock { 0; }
getItemAtIndex_2 = List.GetItemAtIndex(list=transpose, index=code_block_6)
removeItemAtIndex_3 = List.RemoveItemAtIndex(list=getItemAtIndex_2, indices=code_block_5)
watch_2 = Watch(removeItemAtIndex_3)
watch_3 = Watch(transpose)

string_from_object = FromObject(object=watch_2)
code_block_7 = CodeBlock { "Sheet Number"; }
getParameterValueByName = Element.GetParameterValueByName(element=byCategory, parameterName=code_block_7)
watch_4 = Watch(getParameterValueByName)
removeItemAtIndex_4 = List.RemoveItemAtIndex(list=watch_4, indices=code_block)

# group: Drawing Check
watch_5 = Watch(removeItemAtIndex_4)

string_from_object_2 = FromObject(object=watch_5)
indexOf = List.IndexOf(list=string_from_object, element=string_from_object_2)

# group: Drawing Check
watch_6 = Watch(indexOf)

getItemAtIndex_3 = List.GetItemAtIndex(list=watch, index=watch_6)
setParameterByName = Element.SetParameterByName(element=removeItemAtIndex, parameterName=code_block_2, value=getItemAtIndex_3)
code_block_8 = CodeBlock { "SHT_Aconex Number"; }
getParameterValueByName_2 = Element.GetParameterValueByName(element=byCategory, parameterName=code_block_8)
watch_7 = Watch(getParameterValueByName_2)
removeItemAtIndex_5 = List.RemoveItemAtIndex(list=watch_7, indices=code_block)
watch_8 = Watch(removeItemAtIndex_5)
